# Grasshopper definition FacadeEmbed_JinQiao_Podium.gh (Grasshopper 1.0.7)
# plug-ins: EleFront, Wombat, Hare, Pufferfish, TT Toolbox

# ---- group: 钢结构预埋
crv = Curve([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])

# ---- group: 板槽
inblock = InsertBlock(BlockName="xxx", SourcePlane=PlaneXY(0, 0, 0))

# ----
# 单体选型
list = ValueList({"板埋": 0, "槽埋": 1, "板槽埋": 2}, selected="槽埋")
list_2 = ValueList({"顶埋": 0, "侧埋": 1}, selected="顶埋")
panel = Panel(list)
panel_2 = Panel(list_2)

# ----
# 1.输入block names
data = Data(["PX-GLAZ-F2$0$PX-GLAZ-F2$0$fin", "PX-GLAZ-F2$0$PX-GLAZ-F1$0$fin"])
panel_3 = Panel(data)

# ----
# Prep
# 区分有Plane 和 无Plane的 Block
# block names
listblockd = ListBlockDocument()
panel_5 = Panel(listblockd)
refblock = ReferenceBlockByName(BlockName=panel_3)
deblock = DeconstructBlock(Block=refblock)  # -> Name, Plane, Geometry

# ----
# 找到定位的Block&Curve
# 完成后逐个按Update按钮
# block names
# Later:
# 处理定位点不是Block的情况
# 以及定位点是Blcok、Curves与建筑线不同组合可能
listblockd_2 = ListBlockDocument()
panel_6 = Panel(listblockd_2)

# ----
# Input Blocks (have Plan)
# 主体定位点
data_2 = Data(["PX-GLAZ-F2$0$PX-GLAZ-F1$0$标准块", "PX-GLAZ-F2$0$PX-GLAZ-F2$0$标准块", "PX-GLAZ-F2$0$PX-GLAZ-F3$0$标准块", "PX-GLAZ-F2$0$T3T"])

# ----
# Input Blocks转换的Curves
# 主体定位点
crv_2 = Curve(<curve referenced from the Rhino model>)

# ---- group: 结构线
crv_3 = Curve(<curve referenced from the Rhino model>)

# ----
# 平面定位INPUT
crv_4 = Curve([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])

# ---- group: 玻璃线
玻璃线 = Curve(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)
玻璃线_2 = Curve(<curve referenced from the Rhino model>)
玻璃线_3 = Curve(<curve referenced from the Rhino model>)

# ---- group: 定位竖料
crv_5 = Curve([<curve referenced from the Rhino model> x300])
crv_6 = Curve([<curve referenced from the Rhino model> x180])
crv_7 = Curve([<curve referenced from the Rhino model> x383])

# ----
# 按图层整理curves
# 完成后逐个按Update按钮
panel_7 = Panel("Arch_curve_doubleLine")
reflay = ReferenceByLayer(LayerName="Arch_curve_smooth")
reflay_2 = ReferenceByLayer(LayerName=panel_7)
reflay_3 = ReferenceByLayer(LayerName="Arch_curve_angular_withLocation")
reflay_4 = ReferenceByLayer(LayerName="Arch_curve_angular")
reflay_5 = ReferenceByLayer(LayerName="ArchCurve_Whole")

# ----
# Input Curve
# 2层时内部定位点
crv_8 = Curve(<curve referenced from the Rhino model>)

# ---- group: 混凝土
# 板埋几何INPUT
list_3 = ValueList({"C15": 0, "C20": 1, "C25": 2, "C30": 3, "C35": 4, "C40": 5}, selected="C35")

# ---- group: 钢筋牌号
list_4 = ValueList({"HPB300": 0, "HRB400": 1}, selected="HPB300")

# ---- group: 直径
list_5 = ValueList({"10": 0, "12": 1, "16": 2, "18": 3, "20": 4, "25": 5}, selected="12")

# ---- group: 列
list_6 = ValueList({"2X": 0, "3X": 1, "4X": 2}, selected="3X")

# ---- group: 行
list_7 = ValueList({"2Y": 0, "3Y": 1, "4Y": 2}, selected="2Y")

# ---- group: 锚筋间距
s_x = Slider(22, range=14..60, expression="X*5")
s_y = Slider(22, range=14..60, expression="X*5")

# ----
crv_9 = Curve([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])

layer = ObjectLayer(Guid=crv_8)  # -> LayerIndex, LayerPathName
panel_8 = Panel(layer.LayerPathName)
reflay_6 = ReferenceByLayer(LayerName=panel_8)
xy = XYPlane(Origin=Point(0, 0, 0))
project = Project(Geometry=reflay_6, Plane=xy)  # -> Geometry, Transform

panel_9 = Panel(data_2)
layer_2 = ObjectLayer(Guid=crv_2)  # -> LayerIndex, LayerPathName
panel_11 = Panel(layer_2.LayerPathName)
reflay_7 = ReferenceByLayer(LayerName=panel_11)
refblock_2 = ReferenceBlockByName(BlockName=panel_9)
xy_2 = XYPlane(Origin=Point(0, 0, 0))
xy_3 = XYPlane(Origin=Point(0, 0, 0))
project_2 = Project(Geometry=refblock_2, Plane=xy_3)  # -> Geometry, Transform
project_3 = Project(Geometry=reflay_7, Plane=xy_2)  # -> Geometry, Transform

# ----
# 槽埋-角部选择
list_8 = ValueList({"槽埋角部-L形": 0, "槽埋角部-I形": 1}, selected="槽埋角部-I形")

join = JoinCurves(Curves=crv_9, Preserve=False)
xy_4 = XYPlane(Origin=Point(0, 0, 0))
xy_5 = XYPlane(Origin=Point(0, 0, 0))
xy_6 = XYPlane(Origin=Point(0, 0, 0))
xy_7 = XYPlane(Origin=Point(0, 0, 0))
xy_8 = XYPlane(Origin=Point(0, 0, 0))
flip = FlipCurve(Curve=玻璃线)  # -> Curve, Flag
boundary = BoundarySurfaces(Edges=join)
project_4 = Project(Geometry=reflay, Plane=xy_4)  # -> Geometry, Transform
project_5 = Project(Geometry=reflay_2, Plane=xy_5)  # -> Geometry, Transform
project_6 = Project(Geometry=reflay_3, Plane=xy_6)  # -> Geometry, Transform
project_7 = Project(Geometry=reflay_4, Plane=xy_7)  # -> Geometry, Transform
project_8 = Project(Geometry=reflay_5, Plane=xy_8)  # -> Geometry, Transform

# ----
# 2.检测plane是否存在
pln = Plane(deblock.Plane)

filter = StreamFilter(Gate=Toggle(True), Stream0=玻璃线, Stream1=flip.Curve)
sunion = SolidUnion(Breps=boundary)
crv_10 = Curve(project_4.Geometry)
crv_11 = Curve(project_5.Geometry)
crv_12 = Curve(project_6.Geometry)
crv_13 = Curve(project_7.Geometry)
crv_14 = Curve(project_8.Geometry)
offset = OffsetCurve(Curve=filter, Distance=expr("-x", Slider(375, range=0..1000)), Corners=1)
area = Area(Geometry=sunion)  # -> Area, Centroid
pt = Point(area.Centroid)

# ----
# 3.如果不存在则Blake geometry
# 并在rhino里面清理线段
geo = Geometry(deblock.Geometry)

explode = Explode(Curve=offset, Recursive=True)  # -> Segments, Vertices

# ---- group: 钢结构预埋
# 随文件数据请勿覆盖
crv_15 = Curve([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])

# ---- group: 槽埋3D
brep = Brep(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)

# ----
pt_2 = Point(explode.Vertices)
entwine = Entwine(Branch00=sunion, Branch01=pt, FlattenInputs=True)
max = Maximum(A=s_x, B=s_y)
flip_2 = FlipMatrix(Data=entwine)
filter_2 = StreamFilter(Gate=list_3, Stream0=7.2, Stream1=9.6, Stream2=11.9, Stream3=14.3, Stream4=16.7, Stream5=19.1)
filter_3 = StreamFilter(Gate=list_4, Stream0=270, Stream1=360)
filter_4 = StreamFilter(Gate=list_5, Stream0=10, Stream1=12, Stream2=16, Stream3=18, Stream4=20, Stream5=25)
filter_5 = StreamFilter(Gate=list_3, Stream0=0.91, Stream1=1.1, Stream2=1.27, Stream3=1.43, Stream4=1.57, Stream5=1.71)
filter_6 = StreamFilter(Gate=list_4, Stream0=0.16, Stream1=0.14)
addition = Addition(A=list_6, B=1)
addition_2 = Addition(A=list_7, B=1)
division = Division(A=max, B=8)

# ---- group: 建筑定位轮廓
item = ListItem(List=flip_2, Index="0", Wrap=True)  # -> flatten(Item)

# ---- group: 埋件定位点
item_2 = ListItem(List=flip_2, Index="-1", Wrap=True)  # -> flatten(Item)

# ----
t = Integer(division)
panel_12 = Panel(filter_5)
panel_13 = Panel(filter_2)
panel_14 = Panel(filter_6)
min = Minimum(A=filter_3, B=300)

# ----
# remove duplicate blocks
deblock_2 = DeconstructBlock(Block=project_2.Geometry)  # -> Name, Plane, Geometry
pln_2 = Plane(flatten(deblock_2.Plane))
deplane = DeconstructPlane(Plane=pln_2)  # -> Origin, XAxis, YAxis, ZAxis
cullduppoints = RemoveDuplicatePoints(InputPoints=deplane.Origin, Tolerance=0.001)  # -> OutputPoints, FirstPointIndexes
null = NullItem(Item=cullduppoints.FirstPointIndexes)  # -> NullFlags, InvalidFlags, Description
dispatch = Dispatch(List=pln_2, DispatchPattern=null.InvalidFlags)  # -> ListA, ListB
dispatch_2 = Dispatch(List=flatten(project_2.Geometry), DispatchPattern=null.InvalidFlags)  # -> ListA, ListB
pln_3 = Plane(dispatch.ListA)

# ----
# remove duplicate curves
geo_2 = Geometry(project.Geometry)
boundary_2 = BoundarySurfaces(Edges=geo_2)
area_2 = Area(Geometry=boundary_2)  # -> Area, Centroid
cullduppoints_2 = RemoveDuplicatePoints(InputPoints=area_2.Centroid, Tolerance=Slider(0.1, range=0..0.1))  # -> OutputPoints, FirstPointIndexes
null_2 = NullItem(Item=cullduppoints_2.FirstPointIndexes)  # -> NullFlags, InvalidFlags, Description
dispatch_3 = Dispatch(List=boundary_2, DispatchPattern=null_2.NullFlags)  # -> ListA, ListB
geo_3 = Geometry(dispatch_3.ListA)

brep_2 = Brep(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)
panel_15 = Panel(min)

# ----
# 调换阴阳角设定
toggle = BooleanToggle(False)

# ----
# 求内部曲线转折点
crv_16 = Curve(crv_11)
disc = Discontinuity(Curve=graft(crv_16), Level=1)  # -> Points, Parameters
number_slider = Slider(300, range=0..1000)
crv_cp = CurveClosestPoint(Point=disc.Points, Curve=graft(crv_16))  # -> Point, Parameter, Distance
neg = Negative(Value=number_slider)
eval = EvaluateCurve(Curve=graft(crv_16), Parameter=crv_cp.Parameter)  # -> flatten(Point), Tangent, flatten(Angle)
filter_7 = StreamFilter(Gate=toggle, Stream0=number_slider, Stream1=neg)
deg = Degrees(Radians=eval.Angle)
offset_2 = OffsetCurve(Curve=crv_16, Distance=expr("-X", filter_7), Corners=1)
panel_16 = Panel(deg)
larger = LargerThan(FirstNumber=deg, SecondNumber=Slider(60, range=0..100))  # -> LargerThan, OrEqualTo
disc_2 = Discontinuity(Curve=offset_2, Level=1)  # -> flatten(Points), Parameters
dispatch_4 = Dispatch(List=eval.Point, DispatchPattern=larger.LargerThan)  # -> ListA, ListB
end = EndPoints(Curve=crv_16)  # -> Start, End
data_3 = Data(dispatch_4.ListA)
pull = PullPoint(Point=data_3, Geometry=flatten(offset_2), ClosestOnly=True)  # -> ClosestPoint, Distance
testpoint = TestPoint(archPoint=pull.ClosestPoint, crvPoint=disc_2.Points)  # -> out, specialPt; inputs archPoint: list of Point3d, crvPoint: list of Point3d
# ---------- testpoint: C# ----------
    List<int> passIndex = new List<int>();

    for(int i = 0; i < archPoint.Count; i++){
      foreach(Point3d t in crvPoint){
        if(archPoint[i].X == t.X && archPoint[i].Y == t.Y && archPoint[i].Z == t.Z){
          Print("pass");
          passIndex.Add(i);}
      }
    }

    specialPt = passIndex;
# ---------- end testpoint ----------

expression = Expression(A=filter_6, fy=filter_3, ft=filter_5, d=filter_4, Expression="(int((0.6*1.1*A*fy/ft*d)/5)+1)*5")

deplane_2 = DeconstructPlane(Plane=pln_3)  # -> Origin, XAxis, YAxis, ZAxis
deblock_3 = DeconstructBlock(Block=dispatch_2.ListA)  # -> Name, Plane, Geometry
data_4 = Data(dispatch_2.ListA)

area_3 = Area(Geometry=geo_3)  # -> Area, Centroid
crv_17 = Curve(crv_11)
pull_2 = PullPoint(Point=area_3.Centroid, Geometry=crv_17, ClosestOnly=True)  # -> ClosestPoint, Distance

# ----
# 导入槽埋模型
brep_3 = Brep(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)

# ---- group: 槽埋
# 槽埋Modeling
brep_4 = Brep(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)
bbox = BoundingBox(Content=brep_3, Plane=PlaneXY(0, 0, 0))  # -> Box, Box_2
debox = DeconstructBox(Box=bbox.Box)  # -> Plane, X, Y, Z
area_4 = Area(Geometry=brep_3)  # -> Area, Centroid
pdecon = Deconstruct(Point=area_4.Centroid)  # -> XComponent, YComponent, ZComponent
dedomain = DeconstructDomain(Domain=debox.Z)  # -> Start, End
xy_9 = XYPlane(Origin=Point(0, 0, 0))
pt_3 = ConstructPoint(XCoordinate=pdecon.XComponent, YCoordinate=pdecon.YComponent, ZCoordinate=dedomain.End)
pl_origin = PlaneOrigin(Base=xy_9, Origin=pt_3)
xy_10 = XYPlane(Origin=Point(0, 0, 0))
orient = Orient(Geometry=brep_3, Source=pl_origin, Target=xy_10)  # -> Geometry, Transform

# ----
dist = Distance(PointA=pull_2.ClosestPoint, PointB=data_3)
sort = SortList(Keys=dist)  # -> Keys, ValuesA
panel_17 = Panel(sort.Keys)
smaller = SmallerThan(FirstNumber=dist, SecondNumber=Slider(200, range=0..1000))  # -> SmallerThan, OrEqualTo

# ----
# 阴角
item_3 = ListItem(List=data_3, Index=testpoint.specialPt, Wrap=True)

# ----
# SmoothCurve-阴角&阳角
# 阳角
cull_i = CullIndex(List=data_3, Indices=testpoint.specialPt, Wrap=True)

edges = BrepEdges(Brep=bbox.Box)  # -> Naked, Interior, NonManifold
item_4 = ListItem(List=edges.Interior, Index="5", Wrap=True)
item_5 = ListItem(List=edges.Interior, Index="4", Wrap=True)
clx = CurveLine(Curve=item_5, Line=item_4)  # -> Points, Params, Count
Y = UnitY(Factor=item_4)
rotate = Rotate(Geometry=brep_3, Angle=1.570796327, Plane=clx.Points)  # -> Geometry, Transform
move = Move(Geometry=rotate.Geometry, Motion=Y)  # -> Geometry, Transform
merge = Merge(Data1=brep_3, Data2=move.Geometry)  # -> flatten(Result)
sunion_2 = SolidUnion(Breps=merge)
bbox_2 = BoundingBox(Content=sunion_2, Plane=PlaneXY(0, 0, 0))  # -> Box, Box_2
area_5 = Area(Geometry=sunion_2)  # -> Area, Centroid
debox_2 = DeconstructBox(Box=bbox_2.Box)  # -> Plane, X, Y, Z
pdecon_2 = Deconstruct(Point=area_5.Centroid)  # -> XComponent, YComponent, ZComponent
dedomain_2 = DeconstructDomain(Domain=debox_2.Z)  # -> Start, End
pt_4 = ConstructPoint(XCoordinate=pdecon_2.XComponent, YCoordinate=pdecon_2.YComponent, ZCoordinate=dedomain_2.End)
xy_11 = XYPlane(Origin=Point(0, 0, 0))
pl_origin_2 = PlaneOrigin(Base=xy_11, Origin=pt_4)
xy_12 = XYPlane(Origin=Point(0, 0, 0))
orient_2 = Orient(Geometry=sunion_2, Source=pl_origin_2, Target=xy_12)  # -> Geometry, Transform

dispatch_5 = Dispatch(List=geo_3, DispatchPattern=smaller.SmallerThan)  # -> ListA, ListB

# ----
# 第二层-阴阳角
data_5 = Data(dispatch_5.ListA)
explode_2 = Explode(Curve=data_5, Recursive=True)  # -> Segments, Vertices
len = Length(Curve=explode_2.Segments)
sort_2 = SortList(Keys=reverse(len), ValuesA=explode_2.Segments)  # -> Keys, ValuesA
item_6 = ListItem(List=sort_2.ValuesA, Index=0, Wrap=True)  # -> flatten(Item)
area_6 = Area(Geometry=data_5)  # -> Area, Centroid
midpt = CurveMiddle(Curve=item_6)
move2pt = MoveToPoint(Geometry=item_6, PointA=midpt, PointB=area_6.Centroid)  # -> Moved, Vector, Transform
end_2 = EndPoints(Curve=move2pt.Moved)  # -> Start, End
ln = Line(StartPoint=end_2.Start, EndPoint=end_2.End)
neg_2 = Negative(Value="0.5 * Pi")
filter_8 = StreamFilter(Gate=Toggle(True), Stream0="0.5 * Pi", Stream1=neg_2)
xy_13 = XYPlane(Origin=end_2.End)
rotate_2 = Rotate(Geometry=ln, Angle=filter_8, Plane=xy_13)  # -> Geometry, Transform
pl = ConstructPlane(Origin=end_2.End, XAxis=rotate_2.Geometry, YAxis=ln)

# ----
# 第二层-大面定位
data_6 = Data(dispatch_5.ListB)
explode_3 = Explode(Curve=data_6, Recursive=True)  # -> Segments, Vertices
len_2 = Length(Curve=explode_3.Segments)
sort_3 = SortList(Keys=reverse(len_2), ValuesA=explode_3.Segments)  # -> Keys, ValuesA
item_7 = ListItem(List=sort_3.ValuesA, Index=0, Wrap=True)  # -> flatten(Item)
area_7 = Area(Geometry=data_6)  # -> Area, Centroid
midpt_2 = CurveMiddle(Curve=item_7)
move2pt_2 = MoveToPoint(Geometry=item_7, PointA=midpt_2, PointB=area_7.Centroid)  # -> Moved, Vector, Transform
end_3 = EndPoints(Curve=move2pt_2.Moved)  # -> Start, End
ln_2 = Line(StartPoint=end_3.Start, EndPoint=end_3.End)
neg_3 = Negative(Value="0.5 * Pi")
filter_9 = StreamFilter(Gate=Toggle(True), Stream0="0.5 * Pi", Stream1=neg_3)
xy_14 = XYPlane(Origin=end_3.End)
rotate_3 = Rotate(Geometry=ln_2, Angle=filter_9, Plane=xy_14)  # -> Geometry, Transform
pl_2 = ConstructPlane(Origin=end_3.End, XAxis=rotate_3.Geometry, YAxis=ln_2)

# ----
# 导入槽埋模型
brep_5 = Brep(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)

filter_10 = StreamFilter(Gate=list_8, Stream0=orient_2.Geometry, Stream1=orient.Geometry)
entwine_2 = Entwine(Branch00=orient.Geometry, Branch01=filter_10, FlattenInputs=True)

# ----
# 第二层-区分阴阳角
dist_2 = Distance(PointA=graft(end_2.End), PointB=cull_i)
sort_4 = SortList(Keys=dist_2)  # -> Keys, ValuesA
item_8 = ListItem(List=sort_4.Keys, Index=0, Wrap=True)
smaller_2 = SmallerThan(FirstNumber=item_8, SecondNumber=Slider(100, range=0..300))  # -> SmallerThan, OrEqualTo
flatten = FlattenTree(Tree=item_8, Path="{0}")
panel_18 = Panel(flatten)
dispatch_6 = Dispatch(List=graft(pl), DispatchPattern=smaller_2.SmallerThan)  # -> ListA, ListB
crv_18 = Curve(crv_11)

data_7 = Data(flatten(dispatch_6.ListA))
deplane_3 = DeconstructPlane(Plane=data_7)  # -> Origin, XAxis, YAxis, ZAxis
amp = Amplitude(Vector=deplane_3.YAxis, Amplitude=Slider(300, range=0..1000))
move_2 = Move(Geometry=deplane_3.Origin, Motion=amp)  # -> Geometry, Transform
ln_3 = Line(StartPoint=deplane_3.Origin, EndPoint=move_2.Geometry)
merge_2 = Merge(Data1=ln_3, Data2=crv_18)
mcx = MultipleCurves(Curves=flatten(merge_2))  # -> Points, IndexA, IndexB, ParamA, ParamB

data_8 = Data(flatten(dispatch_6.ListB))
deplane_4 = DeconstructPlane(Plane=data_8)  # -> Origin, XAxis, YAxis, ZAxis
amp_2 = Amplitude(Vector=deplane_4.YAxis, Amplitude=Slider(300, range=0..1000))
move_3 = Move(Geometry=deplane_4.Origin, Motion=amp_2)  # -> Geometry, Transform
ln_4 = Line(StartPoint=deplane_4.Origin, EndPoint=move_3.Geometry)
merge_3 = Merge(Data1=ln_4, Data2=crv_18)
mcx_2 = MultipleCurves(Curves=flatten(merge_3))  # -> Points, IndexA, IndexB, ParamA, ParamB

# ----
# InsideCurve-阳角
move2pt_3 = MoveToPoint(Geometry=data_7, PointA=deplane_3.Origin, PointB=mcx.Points)  # -> Moved, Vector, Transform

# ----
# InsideCurve-阴角
move2pt_4 = MoveToPoint(Geometry=data_8, PointA=deplane_4.Origin, PointB=mcx_2.Points)  # -> Moved, Vector, Transform

crv_19 = Curve(offset)
crv_20 = Curve([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])
crv_21 = Curve(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)
merge_4 = Merge(Data1=crv_20, Data2=crv_21)

# ----
# 求主体曲线转折点
clscrv = CloseCurve(Curve=crv_14, CloseType=0, Bulge=0.5, Tolerance=0)  # -> Closed, R
crv_22 = Curve(crv_10)
disc_3 = Discontinuity(Curve=graft(crv_22), Level=1)  # -> Points, Parameters
crv_cp_2 = CurveClosestPoint(Point=disc_3.Points, Curve=graft(crv_22))  # -> Point, Parameter, Distance
eval_2 = EvaluateCurve(Curve=graft(crv_22), Parameter=crv_cp_2.Parameter)  # -> flatten(Point), Tangent, flatten(Angle)
deg_2 = Degrees(Radians=eval_2.Angle)
offset_3 = OffsetCurve(Curve=clscrv.Closed, Distance=expr("-X", Slider(300, range=0..1000)), Corners=1)
panel_19 = Panel(deg_2)
larger_2 = LargerThan(FirstNumber=deg_2, SecondNumber=Slider(60, range=0..100))  # -> LargerThan, OrEqualTo
disc_4 = Discontinuity(Curve=offset_3, Level=1)  # -> flatten(Points), Parameters
dispatch_7 = Dispatch(List=eval_2.Point, DispatchPattern=larger_2.LargerThan)  # -> ListA, ListB

# ----
# 转角点
data_9 = Data(dispatch_7.ListA)

pull_3 = PullPoint(Point=data_9, Geometry=flatten(offset_3), ClosestOnly=True)  # -> ClosestPoint, Distance
testpoint_2 = TestPoint(archPoint=pull_3.ClosestPoint, crvPoint=disc_4.Points)  # -> out, specialPt; inputs archPoint: list of Point3d, crvPoint: list of Point3d; same code as testpoint

# ----
# 找阴阳角所在corners
pull_4 = PullPoint(Point=flatten(deblock_3.Plane), Geometry=crv_22, ClosestOnly=True)  # -> ClosestPoint, Distance
pull_5 = PullPoint(Point=pull_4.ClosestPoint, Geometry=data_9, ClosestOnly=True)  # -> ClosestPoint, Distance
flatten_2 = FlattenTree(Tree=data_4, Path="{0}")
sort_5 = SortList(Keys=pull_5.Distance, ValuesA=flatten_2)  # -> Keys, ValuesA
panel_20 = Panel(sort_5.Keys)
smaller_3 = SmallerThan(FirstNumber=sort_5.Keys, SecondNumber=Slider(100, range=0..100))  # -> SmallerThan, OrEqualTo
dispatch_8 = Dispatch(List=sort_5.ValuesA, DispatchPattern=smaller_3.SmallerThan)  # -> ListA, ListB
data_10 = Data(dispatch_8.ListA)
deblock_4 = DeconstructBlock(Block=data_10)  # -> Name, Plane, Geometry
deplane_5 = DeconstructPlane(Plane=deblock_4.Plane)  # -> Origin, XAxis, YAxis, ZAxis
pt_5 = Point(data_9)
pull_6 = PullPoint(Point=deplane_5.Origin, Geometry=pt_5, ClosestOnly=True)  # -> ClosestPoint, Distance
cir = Circle(Plane=pull_6.ClosestPoint, Radius=Slider(300, range=0..1000))
crv_23 = Curve(crv_22)
amp_3 = Amplitude(Vector=deplane_5.YAxis, Amplitude=Slider(200, range=0..1000))
ccx = CurveCurve(CurveA=cir, CurveB=crv_23)  # -> Points, ParamsA, ParamsB
move_4 = Move(Geometry=pull_6.ClosestPoint, Motion=amp_3)  # -> Geometry, Transform
item_9 = ListItem(List=ccx.Points, Index=0, Wrap=True)
clean = CleanTree(RemoveNulls=True, RemoveInvalid=True, RemoveEmpty=Toggle(True), Tree=item_9)
ln_5 = Line(StartPoint=pull_6.ClosestPoint, EndPoint=clean)
ln_6 = Line(StartPoint=pull_6.ClosestPoint, EndPoint=move_4.Geometry)
angle = Angle(VectorA=ln_6, VectorB=ln_5)  # -> Angle, Reflex
deg_3 = Degrees(Radians=angle.Angle)
flatten_3 = FlattenTree(Tree=deg_3, Path="{0}")
panel_21 = Panel(flatten_3)
c_script = CSharpScript(angle=flatten_3, minus=Slider(80, range=0..100))  # -> out, results; inputs angle: list of Double, minus: Double
# ---------- c_script: C# ----------
    for(int i = 0; i < angle.Count; i++){
      if (angle[i] > minus){
        angleEach = angle[i] - 90;
        Print("!!!!!!!!");
        MyAngle.Add(angleEach);
      }
      else{
        angleEach = angle[i];
        Print("00000");
        MyAngle.Add(angleEach);
      }

    }

    results = MyAngle;
# ---------- c_script: C# additional code ----------
  List<double> MyAngle = new List<double>();
  double angleEach = 0;
# ---------- end c_script ----------
larger_3 = LargerThan(FirstNumber=c_script.results, SecondNumber=Slider(30, range=0..100))  # -> LargerThan, OrEqualTo
panel_22 = Panel(c_script.results)
dispatch_9 = Dispatch(List=flatten(data_10), DispatchPattern=flatten(larger_3.LargerThan))  # -> ListA, ListB
data_11 = Data(dispatch_9.ListA)

# ----
# remove duplicate block and reconstruct plane
deblock_5 = DeconstructBlock(Block=data_11)  # -> Name, Plane, Geometry
deplane_6 = DeconstructPlane(Plane=flatten(deblock_5.Plane))  # -> Origin, XAxis, YAxis, ZAxis

# ----
# SmoothCurve-阴角&阳角
# 阳角
item_10 = ListItem(List=data_9, Index=testpoint_2.specialPt, Wrap=True)

# ----
# 处理Block(定位点)和它对应的curves
# 从中区分大面和阴阳角
pln_4 = Plane(flatten(pln_3))
deplane_7 = DeconstructPlane(Plane=pln_4)  # -> Origin, XAxis, YAxis, ZAxis
testpoint_3 = TestPoint(archPoint=deplane_7.Origin, crvPoint=deplane_6.Origin)  # -> out, specialPt; inputs archPoint: list of Point3d, crvPoint: list of Point3d; same code as testpoint
cull_i_2 = CullIndex(List=pln_4, Indices=testpoint_3.specialPt, Wrap=True)
pln_5 = Plane(deblock_5.Plane)
dist_3 = Distance(PointA=graft(deplane_6.Origin), PointB=item_10)
sort_6 = SortList(Keys=dist_3)  # -> Keys, ValuesA
item_11 = ListItem(List=sort_6.Keys, Index=0, Wrap=True)
flatten_4 = FlattenTree(Tree=item_11, Path="{0}")
smaller_4 = SmallerThan(FirstNumber=item_11, SecondNumber=Slider(100, range=0..300))  # -> SmallerThan, OrEqualTo
panel_23 = Panel(flatten_4)
dispatch_10 = Dispatch(List=graft(pln_5), DispatchPattern=smaller_4.SmallerThan)  # -> ListA, ListB

# ----
# 阴角
cull_i_3 = CullIndex(List=data_9, Indices=testpoint_2.specialPt, Wrap=True)

# ----
# SmoothCurve-阳角
data_12 = Data(flatten(dispatch_10.ListA))

# ----
# SmoothCurve-阴角
data_13 = Data(flatten(dispatch_10.ListB))

pln_6 = Plane(cull_i_2)

# ---- group: 阴阳角区分
cp = ClosestPoint(Point=pt_2, Cloud=item_2)  # -> ClosestPoint, CPIndex, Distance
item_12 = ListItem(List=item_2, Index=cp.CPIndex, Wrap=True)
crv_cp_3 = CurveClosestPoint(Point=item_12, Curve=offset)  # -> Point, Parameter, Distance
eval_3 = EvaluateCurve(Curve=offset, Parameter=crv_cp_3.Parameter)  # -> Point, Tangent, Angle

# ----
# 板槽埋Modeling
multiplication = Multiplication(A=s_x, B=addition)
multiplication_2 = Multiplication(A=s_y, B=addition_2)
recgrid = Rectangular(Plane=PlaneXY(0, 0, 0), SizeX=s_x, SizeY=s_y, ExtentX=addition, ExtentY=addition_2)  # -> Cells, Points
直径 = Text(filter_4)
division_2 = Division(A=multiplication, B=2)
division_3 = Division(A=multiplication_2, B=2)
vec = VectorXYZ(XComponent=expr("-x", division_2), YComponent=expr("-x", division_3), ZComponent=0)  # -> Vector, Length
move_5 = Move(Geometry=recgrid.Points, Motion=vec.Vector)  # -> Geometry, Transform
division_4 = Division(A=直径, B=2)
cyl = Cylinder(Base=move_5.Geometry, Radius=division_4, Length=expr("-x", expression))
X = UnitX(Factor=直径)
multiplication_3 = Multiplication(A=直径, B=6)
edges_2 = BrepEdges(Brep=cyl)  # -> Naked, Interior, NonManifold
item_13 = ListItem(List=edges_2.Naked, Index=0, Wrap=True)
max_2 = Maximum(A=multiplication_3, B=70)
move_6 = Move(Geometry=item_13, Motion=X)  # -> Geometry, Transform
multiplication_4 = Multiplication(A=max_2, B=2)
addition_3 = Addition(A=multiplication, B=multiplication_4)
addition_4 = Addition(A=multiplication_2, B=multiplication_4)
division_5 = Division(A=t, B=2)
expression_2 = Expression(x=addition_4, Expression="Ceiling(x/10)*10/2")
expression_3 = Expression(x=addition_3, Expression="Ceiling(x/10)*10/2")
round = Round(Number=division_5)  # -> Nearest, Floor, Ceiling
multiplication_5 = Multiplication(A=round.Ceiling, B=2)
dom = ConstructDomain(DomainStart=expr("-x", expression_2), DomainEnd=expression_2)
dom_2 = ConstructDomain(DomainStart=expr("-x", expression_3), DomainEnd=expression_3)
box = DomainBox(Base=PlaneXY(0, 0, 0), X=dom_2, Y=dom, Z=multiplication_5)
Z = UnitZ(Factor=expr("-x", multiplication_5))

multiplication_6 = Multiplication(A=直径, B=5)

Z_2 = UnitZ(Factor=multiplication_6)
extr = Extrude(Base=move_6.Geometry, Direction=Z_2)
cap = CapHoles(Brep=[extr, cyl])
merge_5 = Merge(Data1=cap, Data2=box)
flatten_5 = FlattenTree(Tree=merge_5, Path="{0}")
move_7 = Move(Geometry=flatten_5, Motion=Z)  # -> Geometry, Transform

brep_6 = Brep(move_7.Geometry)

# ----
# 槽埋+板埋合并
bbox_3 = BoundingBox(Content=brep_5, Plane=PlaneXY(0, 0, 0))  # -> Box, Box_2
debox_3 = DeconstructBox(Box=bbox_3.Box)  # -> Plane, X, Y, Z
area_8 = Area(Geometry=brep_5)  # -> Area, Centroid
dedomain_3 = DeconstructDomain(Domain=debox_3.Z)  # -> Start, End
pdecon_3 = Deconstruct(Point=area_8.Centroid)  # -> XComponent, YComponent, ZComponent
xy_15 = XYPlane(Origin=Point(0, 0, 0))
pt_6 = ConstructPoint(XCoordinate=pdecon_3.XComponent, YCoordinate=pdecon_3.YComponent, ZCoordinate=dedomain_3.End)
pl_origin_3 = PlaneOrigin(Base=xy_15, Origin=pt_6)
xy_16 = XYPlane(Origin=Point(0, 0, 0))
orient_3 = Orient(Geometry=brep_5, Source=pl_origin_3, Target=xy_16)  # -> Geometry, Transform
bbox_4 = BoundingBox(Content=orient_3.Geometry, Plane=PlaneXY(0, 0, 0))  # -> Box, Box_2
sdiff = SolidDifference(BrepsA=move_7.Geometry, BrepsB=bbox_4.Box)
sunion_3 = SolidUnion(Breps=[sdiff, orient_3.Geometry])  # -> flatten(Result)

edges_3 = BrepEdges(Brep=bbox_3.Box)  # -> Naked, Interior, NonManifold
item_14 = ListItem(List=edges_3.Interior, Index="5", Wrap=True)
item_15 = ListItem(List=edges_3.Interior, Index="4", Wrap=True)
clx_2 = CurveLine(Curve=item_15, Line=item_14)  # -> Points, Params, Count
Y_2 = UnitY(Factor=item_14)
rotate_4 = Rotate(Geometry=brep_5, Angle=1.570796327, Plane=clx_2.Points)  # -> Geometry, Transform
move_8 = Move(Geometry=rotate_4.Geometry, Motion=Y_2)  # -> Geometry, Transform
merge_6 = Merge(Data1=brep_5, Data2=move_8.Geometry)  # -> flatten(Result)
sunion_4 = SolidUnion(Breps=merge_6)
bbox_5 = BoundingBox(Content=sunion_4, Plane=PlaneXY(0, 0, 0))  # -> Box, Box_2
area_9 = Area(Geometry=sunion_4)  # -> Area, Centroid
debox_4 = DeconstructBox(Box=bbox_5.Box)  # -> Plane, X, Y, Z
pdecon_4 = Deconstruct(Point=area_9.Centroid)  # -> XComponent, YComponent, ZComponent
dedomain_4 = DeconstructDomain(Domain=debox_4.Z)  # -> Start, End
pt_7 = ConstructPoint(XCoordinate=pdecon_4.XComponent, YCoordinate=pdecon_4.YComponent, ZCoordinate=dedomain_4.End)
xy_17 = XYPlane(Origin=Point(0, 0, 0))
pl_origin_4 = PlaneOrigin(Base=xy_17, Origin=pt_7)
xy_18 = XYPlane(Origin=Point(0, 0, 0))
orient_4 = Orient(Geometry=sunion_4, Source=pl_origin_4, Target=xy_18)  # -> Geometry, Transform

entwine_3 = Entwine(Branch00=sunion_3, Branch01=orient_4.Geometry, FlattenInputs=True)

# ----
# 板埋Modeling
multiplication_7 = Multiplication(A=s_x, B=addition)
multiplication_8 = Multiplication(A=s_y, B=addition_2)
recgrid_2 = Rectangular(Plane=PlaneXY(0, 0, 0), SizeX=s_x, SizeY=s_y, ExtentX=addition, ExtentY=addition_2)  # -> Cells, Points
直径_2 = Text(filter_4)
division_6 = Division(A=multiplication_7, B=2)
division_7 = Division(A=multiplication_8, B=2)
vec_2 = VectorXYZ(XComponent=expr("-x", division_6), YComponent=expr("-x", division_7), ZComponent=0)  # -> Vector, Length
move_9 = Move(Geometry=recgrid_2.Points, Motion=vec_2.Vector)  # -> Geometry, Transform
division_8 = Division(A=直径_2, B=2)
cyl_2 = Cylinder(Base=move_9.Geometry, Radius=division_8, Length=expr("-x", expression))
X_2 = UnitX(Factor=直径_2)
multiplication_9 = Multiplication(A=直径_2, B=6)
edges_4 = BrepEdges(Brep=cyl_2)  # -> Naked, Interior, NonManifold
item_16 = ListItem(List=edges_4.Naked, Index=0, Wrap=True)
max_3 = Maximum(A=multiplication_9, B=70)
move_10 = Move(Geometry=item_16, Motion=X_2)  # -> Geometry, Transform
multiplication_10 = Multiplication(A=max_3, B=2)
addition_5 = Addition(A=multiplication_7, B=multiplication_10)
addition_6 = Addition(A=multiplication_8, B=multiplication_10)
division_9 = Division(A=t, B=2)
expression_4 = Expression(x=addition_6, Expression="Ceiling(x/10)*10/2")
expression_5 = Expression(x=addition_5, Expression="Ceiling(x/10)*10/2")
round_2 = Round(Number=division_9)  # -> Nearest, Floor, Ceiling
multiplication_11 = Multiplication(A=round_2.Ceiling, B=2)
dom_3 = ConstructDomain(DomainStart=expr("-x", expression_4), DomainEnd=expression_4)
dom_4 = ConstructDomain(DomainStart=expr("-x", expression_5), DomainEnd=expression_5)
box_2 = DomainBox(Base=PlaneXY(0, 0, 0), X=dom_4, Y=dom_3, Z=multiplication_11)
Z_3 = UnitZ(Factor=expr("-x", multiplication_11))
move_11 = Move(Geometry=box_2, Motion=Z_3)  # -> Geometry, Transform
Z_4 = UnitZ(Factor=expr("-x", multiplication_11))

multiplication_12 = Multiplication(A=直径_2, B=5)

Z_5 = UnitZ(Factor=multiplication_12)
extr_2 = Extrude(Base=move_10.Geometry, Direction=Z_5)
cap_2 = CapHoles(Brep=[extr_2, cyl_2])
merge_7 = Merge(Data1=cap_2, Data2=box_2)
flatten_6 = FlattenTree(Tree=merge_7, Path="{0}")
move_12 = Move(Geometry=flatten_6, Motion=Z_4)  # -> Geometry, Transform

box_3 = DomainBox(Base=PlaneXY(0, 0, 0), X=dom_4, Y=dom_4, Z=multiplication_11)
merge_8 = Merge(Data1=cap_2, Data2=box_3)
flatten_7 = FlattenTree(Tree=merge_8, Path="{0}")
move_13 = Move(Geometry=flatten_7, Motion=Z_4)  # -> Geometry, Transform
entwine_4 = Entwine(Branch00=move_12.Geometry, Branch01=move_13.Geometry, FlattenInputs=True)

# ---- group: 选单体
板埋or槽埋or板槽埋 = StreamFilter(Gate=list, Stream0=entwine_4, Stream1=entwine_2, Stream2=entwine_3)

# ----
# 三视图
# hidden lines of top+pers view
# move to center
# 如果无法完整的生成埋件的三视图，
# 建议选择埋件的3D在Rhino中将
# Top/Perspective/Front/Right 试图缩放至合适大小后重新运行
panel_24 = Panel("""Top
Perspective
Front
Right""")
m2d_rhino = Make2DRhinoView(Name=panel_24, Clip=True)
make2d = Make2D(Geometry=板埋or槽埋or板槽埋, View=m2d_rhino, TangentEdges=False, TangentSeams=False, AutoComputeMake2D=False)  # -> VisibleCurves, VisibleIndex, VisibleType, HiddenCurves, HiddenIndex, HiddenType
bang = ExplodeTree(Data=make2d.VisibleCurves)  # -> Branch0, Branch1, Branch2, Branch3, Branch4, Branch5, Branch6, Branch7
bang_2 = ExplodeTree(Data=make2d.VisibleCurves)  # -> Branch0, Branch1, Branch2, Branch3, Branch4, Branch5, Branch6, Branch7
divdist = DivideDistance(Curve=make2d.HiddenCurves, Distance=Slider(1, range=0..10))  # -> Points, Tangents, Parameters
graft = GraftTree(Tree=make2d.HiddenCurves, IncludeEmptyLists=True, IncludeNullItems=True)
shatter = Shatter(Curve=graft, Parameters=divdist.Parameters)
dispatch_11 = Dispatch(List=shatter, DispatchPattern=[True, False])  # -> ListA, ListB
crv_24 = Curve(dispatch_11.ListA)
pshift = ShiftPaths(Data=crv_24, Offset=-1)
pshift_2 = ShiftPaths(Data=pshift, Offset=-1)
bang_3 = ExplodeTree(Data=pshift_2)  # -> Branch0, Branch1, Branch2, Branch3, Branch4, Branch5, Branch6, Branch7
bang_4 = ExplodeTree(Data=pshift_2)  # -> Branch0, Branch1, Branch2, Branch3, Branch4, Branch5, Branch6, Branch7
entwine_5 = Entwine(Branch00=bang_4.Branch4, Branch01=bang_2.Branch4, FlattenInputs=True)  # -> flatten(Result)
entwine_6 = Entwine(Branch00=bang_4.Branch5, Branch01=bang_2.Branch5, FlattenInputs=True)  # -> flatten(Result)
entwine_7 = Entwine(Branch00=bang_3.Branch0, Branch01=bang.Branch0, FlattenInputs=True)  # -> flatten(Result)
entwine_8 = Entwine(Branch00=bang_3.Branch1, Branch01=bang.Branch1, FlattenInputs=True)  # -> flatten(Result)
entwine_9 = Entwine(Branch00=entwine_7, Branch01=entwine_8, Branch02=bang.Branch2, Branch03=bang.Branch3, FlattenInputs=True)
entwine_10 = Entwine(Branch00=entwine_5, Branch01=entwine_6, Branch02=bang_2.Branch6, Branch03=bang_2.Branch7, FlattenInputs=True)
group = Group(Objects=entwine_9)
group_2 = Group(Objects=entwine_10)
entwine_11 = Entwine(Branch00=group, Branch01=group_2, FlattenInputs=True)
pshift_3 = ShiftPaths(Data=entwine_11, Offset=-1)
pshift_4 = ShiftPaths(Data=entwine_11, Offset=-1)
number_slider_2 = Slider(2, range=0..10)
# Rhino 文件中导入的块名
boxprop = BoxProperties(Box=pshift_3)  # -> Center, Diagonal, Area, Volume, Degeneracy
pt_8 = Point(Point(957.9296072, 367.7685097, 0))
pt_9 = Point("0,0,0")
recgrid_3 = Rectangular(
    Plane=pt_8,
    SizeX=Slider(12, range=1..20, expression="X*50"),
    SizeY=Slider(10, range=1..20, expression="X*50"),
    ExtentX=number_slider_2,
    ExtentY=number_slider_2)  # -> Cells, Points
vec2pt = Vector2Pt(PointA=boxprop.Center, PointB=pt_9, Unitize=False)  # -> Vector, Length
flatten_8 = FlattenTree(Tree=recgrid_3.Points, Path="{0}")
move_14 = Move(Geometry=pshift_4, Motion=vec2pt.Vector)  # -> flatten(Geometry), Transform
orient_5 = Orient(Geometry=flatten(move_14.Geometry), Source=PlaneXY(0, 0, 0), Target=flatten_8)  # -> Geometry, Transform
cull_i_4 = CullIndex(List=orient_5.Geometry, Indices="-1", Wrap=True)
split = SplitList(List=cull_i_4, Index="4")  # -> ListA, ListB
data_14 = Data(split.ListA)
data_15 = Data(split.ListB)
entwine_12 = Entwine(Branch00=data_14, Branch01=data_15, FlattenInputs=True)
geo_4 = Geometry(entwine_12)

# ---- group: 单体定Top/Side
item_17 = ListItem(List=geo_4, Index=2, Wrap=True)
item_18 = ListItem(List=geo_4, Index=Slider(0, range=0..10), Wrap=True)
cluster = Cluster(G=item_18)
cluster_2 = Cluster(G=item_17)

# ---- group: 单体定Top/Side / Top/Side
filter_11 = StreamFilter(Gate=list_2, Stream0=cluster, Stream1=cluster_2)

# ---- group: 单体定Top/Side / Monomer + Top/Side
filter_12 = StreamFilter(Gate=list, Stream0=filter_11, Stream1=filter_11, Stream2=filter_11)  # -> flatten(Stream)

# ---- group: Block
# 自定义块所在图层
# 自定义块所在图层颜色
# 自定义块名称
panel_25 = Panel("Embeded::Embeded")
layer_3 = DefineLayer(Name=panel_25, Color=ColourSwatch(SwatchColor=RGB(255, 0, 0)))
attributes = DefineObjectAttributes(Layer=layer_3)
block = DefineBlock(Geometry=filter_11, Attributes=attributes, BlockName="Steel Plate", BasePlane=PlaneXY(0, 0, 0))

# ---- group: 正常+阳角+阴角区分
cull_i_5 = CullIndex(List=item_2, Indices=cp.CPIndex, Wrap=True)
crv_25 = Curve(offset)
crv_26 = Curve(flip.Curve)
explode_4 = Explode(Curve=crv_25, Recursive=True)  # -> Segments, Vertices
explode_5 = Explode(Curve=crv_26, Recursive=True)  # -> Segments, Vertices

# ---- group: 阴角定位-细化
item_19 = ListItem(List=item, Index=cp.CPIndex, Wrap=True)

# ---- group: 大面
# 大面埋件布置
number_slider_3 = Slider(0.002, range=0..0.01)
filter_13 = StreamFilter(Gate=list_2, Stream0=expression_4, Stream1=number_slider_3)
filter_14 = StreamFilter(Gate=list, Stream0=filter_13, Stream1=expression_4, Stream2=filter_13)
offset_4 = OffsetCurve(Curve=offset, Distance=expr("-x", filter_14), Plane=PlaneXY(0, 0, 0), Corners=1)

# ---- group: 阴阳角区分 (continued)
crv_cp_4 = CurveClosestPoint(Point=item_12, Curve=offset_4)  # -> Point, Parameter, Distance
vec2pt_2 = Vector2Pt(PointA=crv_cp_4.Point, PointB=crv_cp_3.Point, Unitize=False)  # -> expr("-x", Vector), Length
angle_2 = Angle(VectorA=eval_3.Tangent, VectorB=vec2pt_2.Vector)  # -> Angle, Reflex
deg_4 = Degrees(Radians=angle_2.Angle)
smaller_5 = SmallerThan(FirstNumber=deg_4, SecondNumber=89)  # -> SmallerThan, OrEqualTo
dispatch_12 = Dispatch(List=item_12, DispatchPattern=smaller_5.SmallerThan)  # -> ListA, ListB

# ---- group: 正常+阳角+阴角区分 (continued)
data_16 = Data(dispatch_12.ListA)
data_17 = Data(dispatch_12.ListB)
pull_7 = PullPoint(Point=data_16, Geometry=crv_25, ClosestOnly=True)  # -> ClosestPoint, Distance
pull_8 = PullPoint(Point=data_17, Geometry=crv_26, ClosestOnly=True)  # -> ClosestPoint, Distance
c_script_2 = CSharpScript(archPoint=pull_7.ClosestPoint, crvPoint=explode_4.Vertices)  # -> out, specialPt; inputs archPoint: list of Point3d, crvPoint: list of Point3d; same code as testpoint
c_script_3 = CSharpScript(archPoint=pull_8.ClosestPoint, crvPoint=explode_5.Vertices)  # -> out, specialPt; inputs archPoint: list of Point3d, crvPoint: list of Point3d; same code as testpoint
cull_i_6 = CullIndex(List=data_16, Indices=c_script_2.specialPt, Wrap=True)

# ---- group: 阴角定位-细化 (continued)
dispatch_13 = Dispatch(List=item_19, DispatchPattern=smaller_5.SmallerThan)  # -> ListA, ListB
item_20 = ListItem(List=dispatch_13.ListB, Index=c_script_3.specialPt, Wrap=True)
join_2 = JoinCurves(Curves=item_20, Preserve=False)
explode_6 = Explode(Curve=join_2, Recursive=True)  # -> Segments, Vertices
crv_27 = Curve(simplify(explode_6.Segments))
len_3 = Length(Curve=crv_27)
sort_7 = SortList(Keys=len_3, ValuesA=crv_27)  # -> Keys, ValuesA
item_21 = ListItem(List=sort_7.ValuesA, Index=0, Wrap=True)  # -> Item2, Item1, Item
crv_28 = Curve([item_21.Item2, item_21.Item1])
disc_5 = Discontinuity(Curve=crv_28, Level=1)  # -> Points, Parameters
item_22 = ListItem(List=disc_5.Points, Index=0, Wrap=True)
pull_9 = PullPoint(Point=disc_5.Points, Geometry=pt_2, ClosestOnly=True)  # -> ClosestPoint, Distance
crv_cp_5 = CurveClosestPoint(Point=disc_5.Points, Curve=offset)  # -> Point, Parameter, Distance
sort_8 = SortList(Keys=pull_9.Distance, ValuesA=crv_cp_5.Point)  # -> Keys, ValuesA

# ---- group: 正常+阳角+阴角区分 / 正常-遗漏
cull_i_7 = CullIndex(List=data_17, Indices=c_script_3.specialPt, Wrap=True)

# ---- group: 正常+阳角+阴角区分 / 阴角定位点
item_23 = ListItem(List=data_17, Index=c_script_3.specialPt, Wrap=True)

# ---- group: 正常+阳角+阴角区分 / 正常定位点
merge_9 = Merge(Data1=cull_i_5, Data2=cull_i_7, Data3=cull_i_6)

# ---- group: 正常+阳角+阴角区分 / 阳角定位点
item_24 = ListItem(List=data_16, Index=c_script_2.specialPt, Wrap=True)

# ---- group: 阴角定位-细化 / 阴角-2点定位
item_25 = ListItem(List=sort_8.ValuesA, Index=0, Wrap=True)

# ----
# 阳角埋件布置
pt_10 = Point(item_24)
explode_7 = Explode(Curve=crv_19, Recursive=True)  # -> Segments, Vertices
cp_2 = ClosestPoint(Point=pt_10, Cloud=explode_7.Vertices)  # -> ClosestPoint, CPIndex, Distance
cir_2 = Circle(Plane=cp_2.ClosestPoint, Radius=Slider(150, range=0..1000))
pt_11 = Point(cp_2.ClosestPoint)
ccx_2 = CurveCurve(CurveA=cir_2, CurveB=offset)  # -> Points, ParamsA, ParamsB
item_26 = ListItem(List=ccx_2.Points, Index=0, Wrap=True)  # -> Item, Item1
ln_7 = Line(StartPoint=graft(pt_11), EndPoint=graft(item_26.Item))  # -> flatten(Line)
ln_8 = Line(StartPoint=graft(pt_11), EndPoint=graft(item_26.Item1))  # -> flatten(Line)
item_27 = ListItem(List=filter_12, Index="1", Wrap=True)
pl_3 = ConstructPlane(Origin=pt_11, XAxis=ln_7, YAxis=ln_8)
bbox_6 = BoundingBox(Content=graft(item_27), Plane=PlaneXY(0, 0, 0))  # -> Box, Box_2
srf = Surface(bbox_6.Box)
explode_8 = Explode(Curve=srf, Recursive=True)  # -> Segments, Vertices
item_28 = ListItem(List=explode_8.Vertices, Index=0, Wrap=True)  # -> Item, Item1, Item2
ln_9 = Line(StartPoint=graft(item_28.Item1), EndPoint=graft(item_28.Item2))
ln_10 = Line(StartPoint=graft(item_28.Item1), EndPoint=graft(item_28.Item))
ln_11 = Line(StartPoint=graft(item_28.Item1), EndPoint=graft(item_28.Item))
ln_12 = Line(StartPoint=graft(item_28.Item1), EndPoint=graft(item_28.Item2))
pl_4 = ConstructPlane(Origin=item_28.Item1, XAxis=ln_12, YAxis=ln_11)
pl_5 = ConstructPlane(Origin=item_28.Item1, XAxis=ln_10, YAxis=ln_9)
orient_6 = Orient(Geometry=item_27, Source=pl_5, Target=pl_3)  # -> Geometry, Transform
orient_7 = Orient(Geometry=item_27, Source=pl_4, Target=pl_3)  # -> Geometry, Transform
merge_10 = Merge(Data1=orient_6.Geometry, Data2=orient_7.Geometry)
filter_15 = StreamFilter(Gate=list_2, Stream0=orient_6.Geometry, Stream1=merge_10)
bbox_7 = BoundingBox(Content=filter_15, Plane=PlaneXY(0, 0, 0))  # -> Box, Box_2
entwine_13 = Entwine(Branch00=filter_15, Branch01=bbox_7.Box, FlattenInputs=True)
flip_3 = FlipMatrix(Data=entwine_13)
item_29 = ListItem(List=flip_3, Index=-1, Wrap=True)  # -> flatten(Item)
item_30 = ListItem(List=flip_3, Index="0", Wrap=True)  # -> flatten(Item)

# ---- group: 阴角
# 阴角埋件布置
explode_9 = Explode(Curve=crv_19, Recursive=True)  # -> Segments, Vertices
cp_3 = ClosestPoint(Point=item_23, Cloud=explode_9.Vertices)  # -> ClosestPoint, CPIndex, Distance
pshift_5 = ShiftPaths(Data=item_25, Offset=-1)
crv_cp_6 = CurveClosestPoint(Point=pshift_5, Curve=offset_4)  # -> Point, Parameter, Distance
crv_cp_7 = CurveClosestPoint(Point=pshift_5, Curve=offset)  # -> Point, Parameter, Distance
vec2pt_3 = Vector2Pt(PointA=crv_cp_6.Point, PointB=crv_cp_7.Point, Unitize=False)  # -> expr("-x", Vector), Length
eval_4 = EvaluateCurve(Curve=offset, Parameter=crv_cp_7.Parameter)  # -> Point, Tangent, Angle
pl_6 = ConstructPlane(Origin=crv_cp_7.Point, XAxis=eval_4.Tangent, YAxis=vec2pt_3.Vector)
orient_8 = Orient(Geometry=block, Source=PlaneXY(0, 0, 0), Target=pl_6)  # -> Geometry, Transform

# ---- group: 大面 (continued)
crv_cp_8 = CurveClosestPoint(Point=merge_9, Curve=offset_4)  # -> Point, Parameter, Distance
crv_cp_9 = CurveClosestPoint(Point=merge_9, Curve=offset)  # -> Point, Parameter, Distance
vec2pt_4 = Vector2Pt(PointA=crv_cp_8.Point, PointB=crv_cp_9.Point, Unitize=False)  # -> expr("-x", Vector), Length
eval_5 = EvaluateCurve(Curve=offset, Parameter=crv_cp_9.Parameter)  # -> Point, Tangent, Angle
pl_7 = ConstructPlane(Origin=crv_cp_9.Point, XAxis=eval_5.Tangent, YAxis=vec2pt_4.Vector)
orient_9 = Orient(Geometry=block, Source=PlaneXY(0, 0, 0), Target=pl_7)  # -> flatten(Geometry), Transform

# ---- group: Datea / 2
lng = ListLength(List=orient_9.Geometry)
division_10 = Division(A=lng, B=2)
split_2 = SplitList(List=orient_9.Geometry, Index=division_10)  # -> ListA, ListB
data_18 = Data(split_2.ListA)

# ----
bbox_8 = BoundingBox(Content=data_18, Plane=PlaneXY(0, 0, 0))  # -> Box, Box_2
entwine_14 = Entwine(Branch00=data_18, Branch01=bbox_8.Box, FlattenInputs=True)
flip_4 = FlipMatrix(Data=entwine_14)
item_31 = ListItem(List=flip_4, Index=-1, Wrap=True)  # -> flatten(Item)
item_32 = ListItem(List=flip_4, Index="0", Wrap=True)  # -> flatten(Item)
阴角 = Geometry(orient_8.Geometry)

# ---- group: Monomer + Side/Top / Monomer Type
filter_16 = StreamFilter(Gate=list, Stream0=item_29, Stream1=item_29, Stream2=item_29)

# ----
# 槽埋-角部倾斜时
bbox_9 = BoundingBox(Content=item_29, Plane=PlaneXY(0, 0, 0))  # -> Box, Box_2
ln_13 = Line(StartPoint=pt_10, EndPoint=pt_11)
debrep = DeconstructBrep(Brep=bbox_9.Box)  # -> Faces, Edges, Vertices
deplane_8 = DeconstructPlane(Plane=ln_13)  # -> Origin, XAxis, YAxis, ZAxis
len_4 = Length(Curve=debrep.Edges)
sort_9 = SortList(Keys=len_4, ValuesA=debrep.Edges)  # -> Keys, reverse(ValuesA)
amp_4 = Amplitude(Vector=deplane_8.XAxis, Amplitude=Slider(63.5, range=10..100))
item_33 = ListItem(List=sort_9.ValuesA, Index=0, Wrap=True)  # -> Item, Item1, Item2
item_34 = ListItem(List=sort_9.ValuesA, Index=0, Wrap=True)
move_15 = Move(Geometry=deplane_8.Origin, Motion=amp_4)  # -> Geometry, Transform
len_5 = Length(Curve=item_34)
end_4 = EndPoints(Curve=item_33.Item2)  # -> Start, End
end_5 = EndPoints(Curve=item_33.Item1)  # -> Start, End
ln_14 = Line(StartPoint=deplane_8.Origin, EndPoint=move_15.Geometry)
ln_15 = Line(StartPoint=move_15.Geometry, EndPoint=deplane_8.Origin)
avr = Average(Input=[end_5.Start, end_5.End])
ln_16 = Line(StartPoint=end_4.Start, EndPoint=end_4.End)
ln_17 = Line(StartPoint=end_5.Start, EndPoint=avr)
c_script_4 = CSharpScript(iReset=Toggle(True), turns=Slider(30, range=0..100), steps=Slider(10, range=0..10))  # -> out, num; inputs numDefault: Double, iReset: Boolean, turns: Int32, steps: Double
# ---------- c_script_4: C# ----------
    if(iReset){
      number = 0;}

    for(int i = 0; i < turns;i++){
      number = number + steps;
      numStore.Add(number);
      Print(number.ToString());}

    num = numStore;
# ---------- c_script_4: C# additional code ----------
  double number = 0;
  List <double> numStore = new List<double>();
# ---------- end c_script_4 ----------
pl_8 = ConstructPlane(Origin=avr, XAxis=ln_17, YAxis=ln_16)
panel_26 = Panel(c_script_4.num)
amp_5 = Amplitude(Vector=ln_13, Amplitude=graft(c_script_4.num))

item_35 = ListItem(List=flatten(len_5), Index=0, Wrap=True)

ln_18 = Line(StartPoint=pt_10, EndPoint=pt_11)
move_16 = Move(Geometry=pt_11, Motion=ln_18)  # -> Geometry, Transform
ccx_3 = CurveCurve(CurveA=cir_2, CurveB=offset)  # -> Points, ParamsA, ParamsB
item_36 = ListItem(List=ccx_3.Points, Index=0, Wrap=True)  # -> flatten(Item), flatten(Item1)
ln_19 = Line(StartPoint=pt_11, EndPoint=item_36.Item)
ln_20 = Line(StartPoint=pt_11, EndPoint=move_16.Geometry)
ln_21 = Line(StartPoint=pt_11, EndPoint=item_36.Item1)
angle_3 = Angle(VectorA=ln_19, VectorB=ln_20)  # -> Angle, Reflex
angle_4 = Angle(VectorA=ln_21, VectorB=ln_20)  # -> Angle, Reflex
deg_5 = Degrees(Radians=angle_3.Angle)
deg_6 = Degrees(Radians=angle_4.Angle)
item_37 = ListItem(List=ln_20, Index=Slider(3, range=0..4), Wrap=True)
tan = Tangent(Value=degrees(deg_5))
entwine_15 = Entwine(Branch00=ln_19, Branch01=tan, FlattenInputs=True)
tan_2 = Tangent(Value=degrees(deg_6))
division_11 = Division(A=tan, B=tan_2)
panel_27 = Panel(deg_6)
panel_28 = Panel(deg_5)
addition_7 = Addition(A=division_11, B=1)
division_12 = Division(A="1", B=addition_7)
subtraction = Subtraction(A="1", B=division_12)
num = Number(division_12)
larger_4 = LargerThan(FirstNumber=tan, SecondNumber=tan_2)  # -> LargerThan, OrEqualTo

amp_6 = Amplitude(Vector=ln_15, Amplitude=expr("x/2", flatten(item_35)))
amp_7 = Amplitude(Vector=ln_14, Amplitude=expr("x/2", flatten(item_35)))
move_17 = Move(Geometry=pt_11, Motion=amp_6)  # -> Geometry, Transform
move_18 = Move(Geometry=pt_11, Motion=amp_7)  # -> Geometry, Transform
ln_22 = Line(StartPoint=move_17.Geometry, EndPoint=move_18.Geometry)

crv_29 = Curve(ln_22)
mp = Midpoint(Curve=crv_29)
eval_6 = EvaluateCurve(Curve=crv_29, Parameter=subtraction)  # -> Point, Tangent, Angle
eval_7 = EvaluateCurve(Curve=crv_29, Parameter=num)  # -> Point, Tangent, Angle
dispatch_14 = Dispatch(List=eval_6.Point, DispatchPattern=larger_4.OrEqualTo)  # -> ListA, ListB
dispatch_15 = Dispatch(List=eval_7.Point, DispatchPattern=larger_4.OrEqualTo)  # -> ListA, ListB
pt_12 = Point(dispatch_14.ListB)
pt_13 = Point(dispatch_15.ListA)
merge_11 = Merge(Data1=pt_13, Data2=pt_12)
pull_10 = PullPoint(Point=merge_11, Geometry=graft(mp), ClosestOnly=True)  # -> ClosestPoint, Distance
panel_29 = Panel(merge_11)
sort_10 = SortList(Keys=pull_10.Distance, ValuesA=merge_11)  # -> Keys, ValuesA
item_38 = ListItem(List=sort_10.ValuesA, Index=0, Wrap=True)  # -> flatten(Item)
ln_23 = Line(StartPoint=item_38, EndPoint=mp)
panel_30 = Panel(item_38)
move_19 = Move(Geometry=crv_29, Motion=ln_23)  # -> Geometry, Transform

# ---- group: 正常和阳角 - BoundingBox — 测Intersection
entwine_16 = Entwine(Branch00=flip.Curve, Branch01=offset, FlattenInputs=True)
flip_5 = FlipMatrix(Data=entwine_16)
item_39 = ListItem(List=flip_5, Index=0, Wrap=True)  # -> Item, Item1

# ----
move_20 = Move(Geometry=move_19.Geometry, Motion=amp_5)  # -> Geometry, Transform
ccx_4 = CurveCurve(CurveA=move_20.Geometry, CurveB=crv_19)  # -> Points, ParamsA, ParamsB
item_40 = ListItem(List=ccx_4.Points, Index=0, Wrap=True)
item_41 = ListItem(List=ccx_4.Points, Index="-1", Wrap=True)
pshift_6 = ShiftPaths(Data=item_40, Offset=-1)
pshift_7 = ShiftPaths(Data=item_41, Offset=-1)
flip_6 = FlipMatrix(Data=pshift_6)
flip_7 = FlipMatrix(Data=pshift_7)
pt_14 = Point(flip_6)
pt_15 = Point(flip_7)
pull_11 = PullPoint(Point=pt_14, Geometry=graft(mp), ClosestOnly=True)  # -> ClosestPoint, Distance
pull_12 = PullPoint(Point=pt_15, Geometry=graft(mp), ClosestOnly=True)  # -> ClosestPoint, Distance
sort_11 = SortList(Keys=pull_11.Distance, ValuesA=pt_14)  # -> Keys, ValuesA
sort_12 = SortList(Keys=pull_12.Distance, ValuesA=pt_15)  # -> Keys, ValuesA
item_42 = ListItem(List=sort_11.ValuesA, Index="-1", Wrap=True)
item_43 = ListItem(List=sort_12.ValuesA, Index="-1", Wrap=True)
ln_24 = Line(StartPoint=item_43, EndPoint=item_42)

end_6 = EndPoints(Curve=ln_24)  # -> Start, End

avr_2 = Average(Input=[end_6.Start, end_6.End])
pl_9 = ConstructPlane(Origin=avr_2, XAxis=ln_24, YAxis=graft(ln_13))
orient_10 = Orient(Geometry=graft(item_30), Source=pl_8, Target=pl_9)  # -> Geometry, Transform
orient_11 = Orient(Geometry=graft(item_29), Source=pl_8, Target=pl_9)  # -> Geometry, Transform

filter_17 = StreamFilter(Gate=list_8, Stream0=item_29, Stream1=orient_11.Geometry)

# ---- group: Monomer + Side/Top / Monomer Type (continued)
filter_18 = StreamFilter(Gate=list, Stream0=item_29, Stream1=filter_17, Stream2=item_29)

# ---- group: Monomer + Side/Top / Top/Side
filter_19 = StreamFilter(Gate=list_2, Stream0=filter_18, Stream1=filter_16)

# ----
filter_20 = StreamFilter(Gate=list_8, Stream0=item_30, Stream1=orient_10.Geometry)

# ---- group: 阳角分类
filter_21 = StreamFilter(Gate=list, Stream0=item_30, Stream1=filter_20, Stream2=item_30)
filter_22 = StreamFilter(Gate=list, Stream0=item_30, Stream1=item_30, Stream2=item_30)
filter_23 = StreamFilter(Gate=list_2, Stream0=filter_21, Stream1=filter_22)

# ----
阳角 = Geometry(filter_23)

# ---- group: 正常和阳角 - BoundingBox — 测Intersection (continued)
c_script_5 = CSharpScript(BrepMain=item_31, BrepStay=filter_19)  # -> out, BrepInters, BrepRemain, IndexM, IndexS; inputs BrepMain: list of Brep, BrepStay: list of Brep
# ---------- c_script_5: C# ----------
    List<Brep> BrepI = new List<Brep>();
    List<Brep> BrepR = new List<Brep>();
    List<int> num = new List<int>();
    List<int> numS = new List<int>();


    double tolr = Rhino.RhinoDoc.ActiveDoc.ModelAbsoluteTolerance;

    for(int j = 0; j < BrepMain.Count;j++){
      for(int i = 0; i < BrepStay.Count;i++){
        bool test = Rhino.Geometry.Intersect.Intersection.BrepBrep(BrepMain[j], BrepStay[i], tolr, out crv, out pts);
        if(test && crv.Length != 0){
          tryThis = true;
          numS.Add(i);
          break;}
        else{
          tryThis = false;}
      }
      if(tryThis){
        BrepI.Add(BrepMain[j]);
        num.Add(j);
      }
      else{
        BrepR.Add(BrepMain[j]);
      }
    }



    BrepInters = BrepI;
    BrepRemain = BrepR;
    IndexM = num;
    IndexS = numS;
# ---------- c_script_5: C# additional code ----------
  Rhino.Geometry.Curve[] crv;
  Rhino.Geometry.Point3d[] pts;
  bool tryThis;
# ---------- end c_script_5 ----------
item_44 = ListItem(List=item_31, Index=c_script_5.IndexM, Wrap=True)  # -> graft(Item)
item_45 = ListItem(List=filter_19, Index=c_script_5.IndexS, Wrap=True)  # -> graft(Item)
cull_i_8 = CullIndex(List=item_32, Indices=c_script_5.IndexM, Wrap=True)
item_46 = ListItem(List=item_32, Index=c_script_5.IndexM, Wrap=True)  # -> graft(Item)
area_10 = Area(Geometry=item_44)  # -> Area, Centroid
bbx = BrepBrep(BrepA=item_44, BrepB=item_45)  # -> simplify(Curves), Points
area_11 = Area(Geometry=bbx.Curves)  # -> Area, Centroid
ln_25 = Line(StartPoint=area_10.Centroid, EndPoint=area_11.Centroid)
mp_2 = Midpoint(Curve=ln_25)
scale = Scale(Geometry=ln_25, Center=mp_2, Factor=Slider(1000000, range=0..1000000))  # -> Geometry, Transform
ccx_5 = CurveCurve(CurveA=scale.Geometry, CurveB=bbx.Curves)  # -> Points, ParamsA, ParamsB
item_47 = ListItem(List=ccx_5.Points, Index=0, Wrap=True)  # -> Item, Item1
ln_26 = Line(StartPoint=item_47.Item1, EndPoint=item_47.Item)
move_21 = Move(Geometry=item_46, Motion=ln_26)  # -> simplify(Geometry), Transform
bbox_10 = BoundingBox(Content=move_21.Geometry, Plane=PlaneXY(0, 0, 0))  # -> Box, Box_2

# ----
# 这里如果跑红也不要紧，
# 说明单体没有出现相撞的情况
area_12 = Area(Geometry=bbox_10.Box)  # -> Area, Centroid

# ---- group: 正常和阳角 - BoundingBox — 测Intersection (continued)
entwine_17 = Entwine(Branch00=move_21.Geometry, Branch01=area_12.Centroid, FlattenInputs=True)
flip_8 = FlipMatrix(Data=entwine_17)
item_48 = ListItem(List=flip_8, Index="0", Wrap=True)  # -> flatten(Item)
item_49 = ListItem(List=flip_8, Index="-1", Wrap=True)  # -> flatten(Item)
pull_13 = PullPoint(Point=item_49, Geometry=item_39.Item, ClosestOnly=True)  # -> flatten(ClosestPoint), Distance
pull_14 = PullPoint(Point=item_49, Geometry=item_39.Item1, ClosestOnly=True)  # -> flatten(ClosestPoint), Distance
vec2pt_5 = Vector2Pt(PointA=item_49, PointB=pull_13.ClosestPoint, Unitize=False)  # -> Vector, Length
vec2pt_6 = Vector2Pt(PointA=item_49, PointB=pull_14.ClosestPoint, Unitize=False)  # -> Vector, Length
multiplication_13 = Multiplication(A=vec2pt_5.Vector, B=vec2pt_6.Vector)
larger_5 = LargerThan(FirstNumber=multiplication_13, SecondNumber=0)  # -> LargerThan, OrEqualTo
dispatch_16 = Dispatch(List=item_48, DispatchPattern=larger_5.LargerThan)  # -> ListA, ListB

# ---- group: Normal
geo_5 = Geometry(cull_i_8)

# ---- group: Normal-Move
移动 = Geometry(dispatch_16.ListA)

# ----
# PLAN Results
merge_12 = Merge(Data1=geo_5, Data2=阳角, Data3=移动, Data4=阴角)

# ==== cluster Cluster
G = ClusterInput()
rotate = Rotate(Geometry=G, Angle=3.141592654, Plane=PlaneXY(0, 0, 0))  # -> Geometry, Transform
boxprop = BoxProperties(Box=rotate.Geometry)  # -> Center, Diagonal, Area, Volume, Degeneracy
bbox = BoundingBox(Content=rotate.Geometry, Plane=PlaneXY(0, 0, 0))  # -> Box, Box_2
debox = DeconstructBox(Box=bbox.Box)  # -> Plane, X, Y, Z
pdecon = Deconstruct(Point=boxprop.Center)  # -> XComponent, YComponent, ZComponent
dedomain = DeconstructDomain(Domain=debox.Y)  # -> Start, End
pt = ConstructPoint(XCoordinate=pdecon.XComponent, YCoordinate=dedomain.Start, ZCoordinate=pdecon.ZComponent)
xy = XYPlane(Origin=Point(0, 0, 0))
pl_origin = PlaneOrigin(Base=xy, Origin=pt)
orient = Orient(Geometry=rotate.Geometry, Source=pl_origin, Target=xy)  # -> Geometry, Transform
G_2 = ClusterOutput(orient.Geometry)
